vi "index.gviweb"   [LabVIEW NXG 3.1.0]
panel controls:
  "Choose an Assignmet": i32 = -1
uses:
  NI::HTTP::GET.gvi
diagram:
  # Top-Level WebVIs usually contain a While Loop that never stops so that they can continue running as long as the web page is open in the user's web browser.
  while {
    Wait(time to wait=50)
    stop if FALSE
  }
  # Place setup code before the loop. For example, perform initial data communication and wire the results into the loop.
  Concatenate Strings("http://192.168.225.46:8001/", "LabVIEWTIPSEvaluation/GetAssignments") -> w1
  call "GET.gvi"(url=w1) -> (body=w2, error out=w3)
  Unflatten From JSON(JSON string=w2, error in (no error)=w3, type and defaults=string[] []) -> (error out=w4, value=w5)
  Property Node(instance in=reference to "Choose an Assignmet", "Items"=w5, error in=w4)
